# Dynamo graph BuildingPy Dynamo.dyn (Dynamo 2.18.1.5096)

file_path = Filename("C:\Users\mikev\Documents\GitHub\Struct4U\Version 2\BuildingPy.py")
readText = FileSystem.ReadText(file=file_path)
string = StringInput("""
import clr
clr.AddReference('ProtoGeometry')

from Autodesk.DesignScript.Geometry import Point as pnt

p1 = Point(0,0,0)

fram = Frame.by_startpoint_endpoint_rect(Point(0,0,0),Point(0,14400,0),350,500,"350x500",0,BaseConcrete)
OUT = p1, fram.curve3d""")
concat = String.Concat(string0=readText, string1=string)
python_script_from_string = PythonStringNode(script=concat)  # CPython3; unwired: IN[0]
byPointsFaceIndices = Mesh.ByPointsFaceIndices()  # unwired: vertexPositions, indices
python_script = Python()  # CPython3
# ---------- python_script.python (17 lines) ----------
# Load the Python Standard and DesignScript Libraries
import sys
import clr
clr.AddReference('ProtoGeometry')
from Autodesk.DesignScript.Geometry import *

# The inputs to this node will be stored as a list in the IN variables.
dataEnteringNode = IN

p1 = Point.ByCoordinates(0,0,0)
p2 = Point.ByCoordinates(3000,0,0)

l1 = Line.ByStartPointEndPoint(p1,p2)
# Place your code below this line

# Assign your output to the OUT variable.
OUT = p1, l1
# ----------------------------------------
bySweep = Surface.BySweep()  # unwired: profile, path
file_path_2 = Filename("C:\Users\mikev\Documents\GitHub\Struct4U\Version 2\BuildingPy.py")
readText_2 = FileSystem.ReadText(file=file_path_2)
code_block = CodeBlock { "0"; "ProjectName"; }
byCoordinates = Point.ByCoordinates()
code_block_2 = CodeBlock { 1000; 1000; 1000; }
byCoordinates_2 = Point.ByCoordinates(x=code_block_2.out0, y=code_block_2.out1, z=code_block_2.out2)
code_block_3 = CodeBlock { "HEA400"; }
buildingPy_Frame_by_startpoint_endpoint_ = Custom[BuildingPy_Frame_by_startpoint_endpoint_profile](BPy_PythonString=readText_2, StartPoint=byCoordinates, EndPoint=byCoordinates_2, ProfileName=code_block_3)
list_create = List.Create(item0=buildingPy_Frame_by_startpoint_endpoint_)
buildingPy_Project = Custom[BuildingPy_Project](BPy_PythonString=readText_2, ProjectNumber=code_block.out0, ProjectName=code_block.out1, Objects=list_create)
code_block_4 = CodeBlock { "C:/TEMP/test.xml"; }
buildingPy_OpenXFEM4U = Custom[BuildingPy_OpenXFEM4U](BPy_PythonString=readText_2, BPy_Project=buildingPy_Project, TempPath=code_block_4)
